# Grasshopper definition Pavilion_geo_version_3_karamba_kangaroo.gh (Grasshopper 1.0.7)
# plug-ins: treesloth01, Kangaroo2 Components, Karamba3D

panel = Panel(Slider(5, range=4..6))
circle = CircleCNR(Center="0,0,0", Normal=Vector(0, 0, 1), Radius="10")
range = Range(Domain=Domain(0, 1), Steps=panel)
cull_i = CullIndex(List=range, Indices="-1", Wrap=True)
panel_2 = Panel(Slider(11.4, range=10.1..12))
crv = Curve(circle)
eval = EvaluateCurve(Curve=reparameterize(crv), Parameter=cull_i)  # -> Point, Tangent, Angle
circle_2 = CircleCNR(Center=eval.Point, Normal=Vector(0, 0, 1), Radius=panel_2)
cluster = Cluster(crv=crv, crv_2=circle_2)  # -> pt_3, pt_4
dist = Distance(PointA=cluster.pt_4, PointB="0,0,0")
bnd = Bounds(Numbers=dist)
remap = RemapNumbers(Value=dist, Source=bnd, Target=Domain(0, 1))  # -> Mapped, Clipped

graph = GraphMapper(
    remap.Mapped,
    x0=0,
    x1=1,
    y0=0,
    y1=1,
    container_name="Bezier",
    cpx=[0, 0.462587595, 0.5874125957, 1],
    cpy=[0.6394927502, 1, 0.01449275017, 0.328645587])

remap_2 = RemapNumbers(Value=graph, Source=Domain(0, 1), Target=Slider(15.8, range=12..20))  # -> Mapped, Clipped
Z = UnitZ(Factor=Slider(2, range=1..3))
Z_2 = UnitZ(Factor=remap_2.Mapped)
round = Round(Number=remap_2.Mapped)  # -> Nearest, Floor, Ceiling
pline = PolyLine(Vertices=cluster.pt_3, Closed=invert(False))
move = Move(Geometry=cluster.pt_4, Motion=Z_2)  # -> Geometry, Transform
pdecon = Deconstruct(Point=move.Geometry)  # -> XComponent, YComponent, ZComponent
sort = SortList(Keys=round.Nearest)  # -> Keys, ValuesA
sort_2 = SortList(Keys=pdecon.ZComponent, ValuesA=move.Geometry)  # -> Keys, ValuesA
dcon = DeleteConsecutive(Set=sort.Keys, Wrap=False)  # -> Set, Count
bnd_2 = Bounds(Numbers=round.Nearest)
lng = ListLength(List=dcon.Set)
dom = ConstructDomain(DomainStart="1", DomainEnd=expr("x+1", lng))
remap_3 = RemapNumbers(Value=sort_2.Keys, Source=bnd_2, Target=dom)  # -> Mapped, Clipped
clone = CloneStructure(List=sort_2.ValuesA, Structure=remap_3.Mapped)
alongcrv = SortAlongCurve(Points=clone, Curve=crv)  # -> Points, Indices
pline_2 = PolyLine(Vertices=alongcrv.Points, Closed=invert(False))  # -> simplify(Polyline)
crv_2 = Curve(pline)
loft = Loft(
    Curves=flatten([crv_2, pline_2]),
    Options={Adjust=False, Closed=False, LoftEnds=0, LoftSimp=0, LoftType=0, Rebuild=10, Refit=0.01})
move_2 = Move(Geometry=loft, Motion=Z)  # -> Geometry, Transform
brep = Brep(move_2.Geometry)
rotate = Rotate(Geometry=brep, Angle=Slider(0, range=0..1.57), Plane=PlaneXY(0, 0, 0))  # -> Geometry, Transform
debrep = DeconstructBrep(Brep=rotate.Geometry)  # -> Faces, Edges, Vertices
panel_3 = Panel("""False
True""")
flip = Flip(Surface=debrep.Faces)  # -> Surface, Result
srf = Surface(flip.Surface)
debrep_2 = DeconstructBrep(Brep=srf)  # -> Faces, Edges, Vertices
crv_3 = Curve(simplify(debrep_2.Edges))
len = Length(Curve=crv_3)
sort_3 = SortList(Keys=len, ValuesA=crv_3)  # -> Keys, ValuesA
cull = CullPattern(List=srf, CullPattern=panel_3)
item = ListItem(List=sort_3.ValuesA, Index="1", Wrap=True)  # -> Item, Item1, Item2
custom_mesh_settings = SettingsCustom(
    StitchSeams=True,
    SimplePlanes=False,
    Refine=True,
    MinCount=16,
    MaxCount=400,
    AspectRatio=20,
    MaxDistance=0,
    MaxAngle=20,
    MinEdge="1",
    MaxEdge="1")
range_2 = Range(Domain=Domain(0, 1), Steps=Slider(4, range=0..10))
flip_2 = FlipCurve(Curve=item.Item2)  # -> Curve, Flag
planesrf = PlaneSurface(Plane=PlaneXY(0, 0, 0), XSize="-20 to 20", YSize="-20 to 20")
mesh = MeshBrep(Brep=cull, Settings=custom_mesh_settings)
demesh = DeconstructMesh(Mesh=mesh)  # -> Vertices, Faces, Colours, Normals
eval_2 = EvaluateCurve(Curve=reparameterize(item.Item1), Parameter=range_2)  # -> simplify(Point), Tangent, Angle
eval_3 = EvaluateCurve(Curve=reparameterize(flip_2.Curve), Parameter=range_2)  # -> simplify(Point), Tangent, Angle
vdis = VectorDisplay(Anchor=demesh.Vertices, Vector=demesh.Normals)
shift = ShiftList(List=eval_3.Point, Shift=1, Wrap=invert(True))
shift_2 = ShiftList(List=eval_2.Point, Shift=1, Wrap=invert(True))
ln = Line(StartPoint=eval_2.Point, EndPoint=eval_3.Point)
ln_2 = Line(StartPoint=eval_2.Point, EndPoint=shift)
ln_3 = Line(StartPoint=eval_3.Point, EndPoint=shift_2)
loft_2 = Loft(Curves=ln, Options={Adjust=False, Closed=False, LoftEnds=0, LoftSimp=0, LoftType=3, Rebuild=10, Refit=0.01})
debrep_3 = DeconstructBrep(Brep=loft_2)  # -> Faces, Edges, Vertices
line = Line(debrep_3.Edges)
line_2 = Line(ln_3)
line_3 = Line([line_2, line])
cluster_2 = Cluster_3(C=line_3)
cluster_3 = Cluster_2(C=line_3)
eval_4 = EvaluateCurve(Curve=reparameterize(line_3), Parameter="0")  # -> flatten(Point), Tangent, Angle
pline_3 = PolyLine(Vertices=cluster_2, Closed=False)
xy = XYPlane(Origin=cluster_3)
pt = Point(cluster_2)
explode = Explode(Curve=pline_3, Recursive=True)  # -> Segments, Vertices
duppt = RemoveDuplicatePts(Points=eval_4.Point, Tolerance=0.01)
del = DelaunayMesh(Points=flatten(duppt), Plane=PlaneXY(0, 0, 0))
eval_5 = EvaluateCurve(Curve=reparameterize(explode.Segments), Parameter="0")  # -> Point, Tangent, Angle
eval_6 = EvaluateCurve(Curve=reparameterize(explode.Segments), Parameter="1")  # -> Point, Tangent, Angle
X = UnitX(Factor=Slider(0.01, range=0.01..0.5))
edgelengths = EdgeLengths(Mesh=del, LengthFactor=Slider(0, range=0..1), Strength=1)
anchor = Anchor(Point=xy, Strength=Slider(100, range=0..100))
wind = Wind(Mesh=del, WindVector=X)
vertexloads = VertexLoads(Mesh=del, Strength="-1")
nv = NakedVertices(Mesh=del)  # -> ClothedIndex, NakedIndex, ClothedPts, NakedPts
data = Data(nv.ClothedPts)
cp = ClosestPoint(Point=pt, Cloud=data)  # -> ClosestPoint, CPIndex, Distance
show = Show(G=del)
anchor_2 = Anchor(Point=cp.ClosestPoint, Target=pt, Strength=10000)
solver = Solver(
    GoalObjects=[show, vertexloads, anchor, anchor_2, wind, edgelengths],
    Reset=Button(),
    Threshold=1e-15,
    Tolerance=0.0001,
    On=Toggle(True))  # -> I, V, O
bang = ExplodeTree(Data=solver.O)  # -> Branch0, Branch1
line_4 = Line([line, line_2])
mesh_2 = Mesh(bang.Branch0)
mesh_3 = Mesh(del)
rdlines = RemoveDuplicateLinesKaramba3D(Line=flatten(line_4), LimitDistance=0.005)  # -> OutLine, Info, Indexes
demesh_2 = DeconstructMesh(Mesh=mesh_2)  # -> Vertices, Faces, Colours, Normals
demesh_3 = DeconstructMesh(Mesh=mesh_3)  # -> Vertices, Faces, Colours, Normals
dist_2 = Distance(PointA=demesh_2.Vertices, PointB=demesh_3.Vertices)
bnd_3 = Bounds(Numbers=dist_2)
panel_4 = Panel(bnd_3)
dedomain = DeconstructDomain(Domain=bnd_3)  # -> Start, End
gradient = Gradient(LowerLimit=dedomain.Start, UpperLimit="3", Parameter=dist_2, stops=[0.15: RGB(255, 255, 255), 0.85: RGB(220, 0, 40)])

# ---- group: Define Supports
supp = SupportKaramba3D(PosInd=xy, menu=[buttons(on, on, on, off, off, off)])

# ---- group: Define Loads
loads = LoadsKaramba3D(Vector=Vector(0, 0, -1), LCase="0", mode="Gravity")

# ---- group: Define Elements
linetobeam = LineToBeamKaramba3D(
    Line=rdlines.OutLine,
    New=True,
    Remove=True,
    LimitDistance_m=0.005,
    Bending=True,
    SetBucklingLength=True,
    ToPolylineMaxAngle=0.03,
    ToPolylineTolerance=0.01,
    ToPolylineMinEdgeLength=0.25)  # -> Element, Points, Info

# ----
conmesh = ConstructMesh(Vertices=demesh_2.Vertices, Faces=demesh_2.Faces, Colours=gradient)

# ---- group: Assemble Model
assemble = AssembleModelKaramba3D(Elem=linetobeam.Element, Support=supp, Load=loads, LimitDistance_m=0.005)  # -> Model, Info, Mass_kg, CenterOfGravity, LoadCaseNames

# ---- group: Analyze Model
analyze = AnalyzeKaramba3D(Model=assemble.Model)  # -> CalculatedModel, MaximumDisplacement_cm, ResultingForceOfGravity_kN, ElasticEnergy_kNm
panel_5 = Panel(analyze.MaximumDisplacement_cm)

# ---- group: View Results
modelview = ModelViewKaramba3D(Model=analyze.CalculatedModel, ResultFactors=1, ResultCase=-1)  # -> Model, DeformedMesh, DeformedAxes, DeformedModel
beamview = BeamViewKaramba3D(Model=modelview.Model)  # -> Model, MeshesOfRenderedBeams, DeformedBeamAxes, LegendColors, LegendTags
legend = Legend(Colour=beamview.LegendColors, Tags=beamview.LegendTags, LegendType=1)

# ----
utilization = UtilizationOfElementsKaramba3D(
    AnalyzedModel=modelview.Model,
    NumberOfSamplePoints=3,
    ElasticDesign=True,
    GammaM0=1,
    GammaM1=1.1,
    SwayFrame=True,
    WithDetails=False,
    mode="Beams")  # -> AnalyzedModel, Utilization, SigMax_kN_cm2, SigMin_kN_cm2, TauMax_kN_cm2, UtilN, UtilVy, UtilVz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
crv_4 = Curve(rdlines.OutLine)
num = Number(utilization.SigMin_kN_cm2)
pipe = Pipe(Curve=crv_4, Radius=utilization.UtilMy, Caps=0)
bnd_4 = Bounds(Numbers=num)
dedomain_2 = DeconstructDomain(Domain=bnd_4)  # -> Start, End
gradient_2 = Gradient(
    LowerLimit=dedomain_2.Start,
    UpperLimit=dedomain_2.End,
    Parameter=num,
    stops=[0: RGB(220, 0, 40), 0.502: RGB(255, 255, 255), 1: RGB(130, 197, 255)])
panel_6 = Panel(bnd_4)
preview = CustomPreview(Geometry=flatten(pipe), Material=gradient_2)

# ==== cluster Cluster
crv = ClusterInput()
crv_2 = ClusterInput()
crv_3 = Curve(crv)
crv_4 = Curve(crv_2)
mcx = MultipleCurves(Curves=crv_4)  # -> Points, IndexA, IndexB, ParamA, ParamB
incurve = PointInCurve(Point=mcx.Points, Curve=crv_3)  # -> Relationship, Point
path = ConstructPath(Indices=graft(incurve.Relationship))  # -> flatten(Branch)
clone = CloneStructure(List=mcx.Points, Structure=path)
branch = TreeBranch(Tree=clone, Path="0", MaintainPaths=True)
branch_2 = TreeBranch(Tree=clone, Path="2", MaintainPaths=True)
alongcrv = SortAlongCurve(Points=branch, Curve=crv_3)  # -> Points, Indices
pt = Point(alongcrv.Points)
pt_2 = Point(branch_2)
pt_3 = ClusterOutput(pt)
pt_4 = ClusterOutput(pt_2)

# ==== cluster Cluster_2
C = ClusterInput()
end = EndPoints(Curve=C)  # -> Start, End
pdecon = Deconstruct(Point=end.End)  # -> XComponent, YComponent, ZComponent
pdecon_2 = Deconstruct(Point=end.Start)  # -> XComponent, YComponent, ZComponent
sort = SortList(Keys=pdecon.ZComponent, ValuesA=end.End)  # -> Keys, ValuesA
sort_2 = SortList(Keys=pdecon_2.ZComponent, ValuesA=end.Start)  # -> Keys, ValuesA
item = ListItem(List=sort.ValuesA, Index=0, Wrap=True)
item_2 = ListItem(List=sort_2.ValuesA, Index=0, Wrap=True)
cullpt = CullDuplicates(Points=flatten([item, item_2]), Tolerance=0.1, CullMode=3)  # -> Points, Indices, Valence
P = ClusterOutput(cullpt.Points)

# ==== cluster Cluster_3
C = ClusterInput()
end = EndPoints(Curve=C)  # -> Start, End
pdecon = Deconstruct(Point=end.Start)  # -> XComponent, YComponent, ZComponent
pdecon_2 = Deconstruct(Point=end.End)  # -> XComponent, YComponent, ZComponent
sort = SortList(Keys=pdecon_2.ZComponent, ValuesA=end.End)  # -> Keys, ValuesA
sort_2 = SortList(Keys=pdecon.ZComponent, ValuesA=end.Start)  # -> Keys, ValuesA
item = ListItem(List=sort.ValuesA, Index=-1, Wrap=True)  # -> Item1, Item
item_2 = ListItem(List=sort_2.ValuesA, Index=-1, Wrap=True)  # -> Item1, Item
cullpt = CullDuplicates(Points=flatten([item.Item, item_2.Item, item.Item1, item_2.Item1]), Tolerance=0.1, CullMode=3)  # -> Points, Indices, Valence
P = ClusterOutput(cullpt.Points)
