# Grasshopper definition Pavilion_geo_version_3_ladybug.gh (Grasshopper 1.0.7)
# plug-ins: treesloth01, Human

panel = Panel(Slider(5, range=4..6))
circle = CircleCNR(Center="0,0,0", Normal=Vector(0, 0, 1), Radius="10")
range = Range(Domain=Domain(0, 1), Steps=panel)
cull_i = CullIndex(List=range, Indices="-1", Wrap=True)
panel_2 = Panel(Slider(11.6, range=10.1..12))
crv = Curve(circle)
eval = EvaluateCurve(Curve=reparameterize(crv), Parameter=cull_i)  # -> Point, Tangent, Angle
circle_2 = CircleCNR(Center=eval.Point, Normal=Vector(0, 0, 1), Radius=panel_2)
cluster = Cluster(crv=crv, crv_2=circle_2)  # -> pt_3, pt_4
dist = Distance(PointA=cluster.pt_4, PointB="0,0,0")
bnd = Bounds(Numbers=dist)
remap = RemapNumbers(Value=dist, Source=bnd, Target=Domain(0, 1))  # -> Mapped, Clipped

graph = GraphMapper(
    remap.Mapped,
    x0=0,
    x1=1,
    y0=0,
    y1=1,
    container_name="Bezier",
    cpx=[0, 0.5279720426, 0.5874125957, 1],
    cpy=[0.6394927502, 0.9413040876, 0.01449275017, 0.328645587])

remap_2 = RemapNumbers(Value=graph, Source=Domain(0, 1), Target=Slider(16.3, range=12..20))  # -> Mapped, Clipped
Z = UnitZ(Factor=Slider(2, range=1..3))
Z_2 = UnitZ(Factor=remap_2.Mapped)
round = Round(Number=remap_2.Mapped)  # -> Nearest, Floor, Ceiling
pline = PolyLine(Vertices=cluster.pt_3, Closed=invert(False))
move = Move(Geometry=cluster.pt_4, Motion=Z_2)  # -> Geometry, Transform
pdecon = Deconstruct(Point=move.Geometry)  # -> XComponent, YComponent, ZComponent
sort = SortList(Keys=round.Nearest)  # -> Keys, ValuesA
sort_2 = SortList(Keys=pdecon.ZComponent, ValuesA=move.Geometry)  # -> Keys, ValuesA
dcon = DeleteConsecutive(Set=sort.Keys, Wrap=False)  # -> Set, Count
bnd_2 = Bounds(Numbers=round.Nearest)
lng = ListLength(List=dcon.Set)
dom = ConstructDomain(DomainStart="1", DomainEnd=expr("x+1", lng))
remap_3 = RemapNumbers(Value=sort_2.Keys, Source=bnd_2, Target=dom)  # -> Mapped, Clipped
clone = CloneStructure(List=sort_2.ValuesA, Structure=remap_3.Mapped)
alongcrv = SortAlongCurve(Points=clone, Curve=crv)  # -> Points, Indices
pline_2 = PolyLine(Vertices=alongcrv.Points, Closed=invert(False))  # -> simplify(Polyline)
crv_2 = Curve(pline)
loft = Loft(
    Curves=flatten([crv_2, pline_2]),
    Options={Adjust=False, Closed=False, LoftEnds=0, LoftSimp=0, LoftType=0, Rebuild=10, Refit=0.01})
move_2 = Move(Geometry=loft, Motion=Z)  # -> Geometry, Transform
brep = Brep(move_2.Geometry)
rotate = Rotate(Geometry=brep, Angle=Slider(0, range=0..1.57), Plane=PlaneXY(0, 0, 0))  # -> Geometry, Transform
debrep = DeconstructBrep(Brep=rotate.Geometry)  # -> Faces, Edges, Vertices
crv_3 = Curve(debrep.Edges)
previewlw = CustomPreviewLineweights(Geometry=crv_3, Shader="black", Thickness=2, Absolute=False)
panel_3 = Panel("""False
True""")
flip = Flip(Surface=debrep.Faces)  # -> Surface, Result
series = Series(Start=0, Step=1, Count="24")
range_2 = Range(Domain="0 to 59", Steps=Slider(10, range=0..10))  # -> expr("round(x,0)", graft(Range))
srf = Surface(flip.Surface)
cull = CullPattern(List=srf, CullPattern=panel_3)
custom_mesh_settings = SettingsCustom(
    StitchSeams=True,
    SimplePlanes=False,
    Refine=True,
    MinCount=16,
    MaxCount=400,
    AspectRatio=20,
    MaxDistance=0,
    MaxAngle=20,
    MinEdge="1",
    MaxEdge="1")
hoy = LBCalculateHOY(month="6", day="21", hour=series, minute=range_2)  # -> flatten(hoy), flatten(doy), flatten(date); plug-in component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
constrloc = LBConstructLocation(name="somewhere", latitude="55", longitude="45", elevation=0)  # -> location; plug-in component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
planesrf = PlaneSurface(Plane=PlaneXY(0, 0, 0), XSize="-20 to 20", YSize="-20 to 20")
mesh = MeshBrep(Brep=cull, Settings=custom_mesh_settings)
demesh = DeconstructMesh(Mesh=mesh)  # -> Vertices, Faces, Colours, Normals
vdis = VectorDisplay(Anchor=demesh.Vertices, Vector=demesh.Normals)
preview = CustomPreview(Geometry=mesh, Material="white")
sunpath = LBSunPath(location=constrloc, hoys=hoy.hoy, scale=1)  # -> report, vectors, altitudes, azimuths, hoys, sun_pts, analemma, daily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; plug-in component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
directsunhours = LBDirectSunHours(vectors=flatten(sunpath.vectors), geometry=flatten(mesh), grid_size="1", run=Toggle(True))  # -> report, points, results, mesh, legend, title, int_mtx; plug-in component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
directsunhours_2 = LBDirectSunHours(vectors=flatten(sunpath.vectors), geometry=flatten(planesrf), context=flatten(mesh), grid_size="1", run=Toggle(True))  # -> report, points, results, mesh, legend, title, int_mtx; plug-in component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
dom_2 = ConstructDomain(DomainStart="0", DomainEnd="17")
bnd_3 = Bounds(Numbers=directsunhours_2.results)
legendpar = LBLegendParameters(min="0", max="17", seg_count="10", num_decimals="1")  # -> leg_par; plug-in component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
dedomain = DeconstructDomain(Domain=bnd_3)  # -> Start, End
dom_3 = ConstructDomain(DomainStart="0", DomainEnd=dedomain.End)
remap_4 = RemapNumbers(Value=directsunhours_2.results, Source=dom_3, Target=dom_2)  # -> Mapped, Clipped
heatmap = LBSpatialHeatmap(values=remap_4.Mapped, mesh=directsunhours_2.mesh, legend_par=legendpar)  # -> mesh, legend, title, colors, legend_par, vis_set; plug-in component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
meshselector = LBMeshThresholdSelector(values=remap_4.Mapped, mesh=directsunhours_2.mesh, operator="<", abs_threshold=Slider(8, range=0..10))  # -> report, total_value, total_area, sub_mesh, outline; plug-in component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
mesh_2 = Mesh(meshselector.sub_mesh)

# ==== cluster Cluster
crv = ClusterInput()
crv_2 = ClusterInput()
crv_3 = Curve(crv)
crv_4 = Curve(crv_2)
mcx = MultipleCurves(Curves=crv_4)  # -> Points, IndexA, IndexB, ParamA, ParamB
incurve = PointInCurve(Point=mcx.Points, Curve=crv_3)  # -> Relationship, Point
path = ConstructPath(Indices=graft(incurve.Relationship))  # -> flatten(Branch)
clone = CloneStructure(List=mcx.Points, Structure=path)
branch = TreeBranch(Tree=clone, Path="0", MaintainPaths=True)
branch_2 = TreeBranch(Tree=clone, Path="2", MaintainPaths=True)
alongcrv = SortAlongCurve(Points=branch, Curve=crv_3)  # -> Points, Indices
pt = Point(alongcrv.Points)
pt_2 = Point(branch_2)
pt_3 = ClusterOutput(pt)
pt_4 = ClusterOutput(pt_2)
